# Grasshopper definition TestingComponents.ghx (Grasshopper 1.0.8)
# plug-ins: RhinoCodePluginGH

number_slider = Slider(5, range=0..10)
cs = CSharpScript()  # -> out, a
# ---------- cs: C# ----------
// Grasshopper Script Instance
#r "nuget: RestSharp, 106.11.7"

#region Usings
using System;
using System.Collections;
using System.Collections.Generic;
using System.Drawing;

using Rhino;
using Rhino.Geometry;

using Grasshopper;
using Grasshopper.Kernel;
using Grasshopper.Kernel.Data;
using Grasshopper.Kernel.Types;

using RestSharp;
using RestSharp.Authenticators;
#endregion

public class Script_Instance : GH_ScriptInstance
{
    #region Notes
    /* 
      Members:
        RhinoDoc RhinoDocument
        GH_Document GrasshopperDocument
        IGH_Component Component
        int Iteration

      Methods (Virtual & overridable):
        Print(string text)
        Print(string format, params object[] args)
        Reflect(object obj)
        Reflect(object obj, string method_name)
    */
    #endregion

    private void RunScript(object x, object y, ref object a)
    {
        
        var client = new RestClient("https://randomuser.me/api/");
        var request = new RestRequest(Method.GET);
        IRestResponse response = client.Execute(request);

        a = response.Content;
    }
}
# ---------- end cs ----------
cs_2 = CSharpScript()  # -> out, a
# ---------- cs_2: C# ----------
// Grasshopper Script Instance
#r "nuget: RestSharp, 106.11.7"

#region Usings
using System;
using System.Collections;
using System.Collections.Generic;
using System.Drawing;

using Rhino;
using Rhino.Geometry;

using Grasshopper;
using Grasshopper.Kernel;
using Grasshopper.Kernel.Data;
using Grasshopper.Kernel.Types;

using RestSharp;
using RestSharp.Authenticators;
#endregion

public class Script_Instance : GH_ScriptInstance
{
    #region Notes
    /* 
      Members:
        RhinoDoc RhinoDocument
        GH_Document GrasshopperDocument
        IGH_Component Component
        int Iteration

      Methods (Virtual & overridable):
        Print(string text)
        Print(string format, params object[] args)
        Reflect(object obj)
        Reflect(object obj, string method_name)
    */
    #endregion

    private void RunScript(object x, object y, ref object a)
    {
        
        var client = new RestClient("http://httpbin.org");
        var request = new RestRequest("get", DataFormat.Json);
        var response = client.Get(request);

       a = response.Content;
    }
}
# ---------- end cs_2 ----------
py3 = Python3Script(min_limit=Slider(0, range=0..100), max_limit=Slider(10, range=0..10))  # -> out, a
# ---------- py3: Python ----------
#! python 3
# requirements: numpy

import Rhino
import rhinoscriptsyntax as rs
import scriptcontext as sc
import numpy as np


def create_random_points():

    # Generate random coordinates within the given bounds
    num_points = 10  # You can change this to the desired number of points
    x_coords = np.random.uniform(min_limit, max_limit, num_points)
    y_coords = np.random.uniform(min_limit, max_limit, num_points)
    z_coords = np.random.uniform(min_limit, max_limit, num_points)
    # Create Point3d objects and add them to Rhino
    points = []
    for i in range(num_points):
        point = Rhino.Geometry.Point3d(x_coords[i], y_coords[i], z_coords[i])
        points.append(point)

    return points
    # # Add points to Rhino document
    # for point in points:
    #     doc.Objects.AddPoint(point)

    # # Redraw Rhino viewport
    # doc.Views.Redraw()

def bake_points(points):
    for pt in points:
        Rhino.RhinoDoc.ActiveDoc.Objects.AddPoint(pt)

if __name__ == "__main__":
    pts = create_random_points()
    bake_points(pts)
# ---------- end py3 ----------
py3_2 = Python3Script(min_limit=Slider(0, range=0..100), max_limit=Slider(10, range=0..10))  # -> out, a; inputs min_limit: Int32, max_limit: Int32
# ---------- py3_2: Python ----------
#! python 3
# requirements: numpy

import Rhino
import rhinoscriptsyntax as rs
import numpy as np

def create_random_points():

    # Ask the user for minimum and maximum limits
    # min_limit = rs.GetReal("Enter the minimum limit:", minimum=0)
    # max_limit = rs.GetReal("Enter the maximum limit:", minimum=min_limit)

    # if min_limit is None or max_limit is None:
    #     print("Invalid input. Aborting.")
    #     return

    # Generate random coordinates within the given bounds
    num_points = 10  # You can change this to the desired number of points
    x_coords = np.random.uniform(min_limit, max_limit, num_points)
    y_coords = np.random.uniform(min_limit, max_limit, num_points)
    z_coords = np.random.uniform(min_limit, max_limit, num_points)
    # Create Point3d objects and add them to Rhino
    points = []
    for i in range(num_points):
        point = Rhino.Geometry.Point3d(x_coords[i], y_coords[i], z_coords[i])
        points.append(point)
    
    a = points

    # # Add points to Rhino document
    # for point in points:
    #     doc.Objects.AddPoint(point)

    # # Redraw Rhino viewport
    # doc.Views.Redraw()

if __name__ == "__main__":
    create_random_points()
# ---------- end py3_2 ----------
py3_3 = Python3Script(x=number_slider, y=number_slider, z=number_slider)  # -> out, a
# ---------- py3_3: Python ----------
"""Grasshopper Script"""

import Rhino.Geometry as RG

pt = RG.Point3d(x, y, z)
a = pt
# ---------- end py3_3 ----------
panel = Panel(cs.a)
panel_2 = Panel(cs_2.a)
panel_3 = Panel(py3.a)
panel_4 = Panel(py3_3.a)
