# Grasshopper definition TestingDebugGH.ghx (Grasshopper 1.0.8)
# plug-ins: RhinoCodePluginGH

number_slider = Slider(6, range=0..10)
series = Series(Start=Slider(1, range=0..1), Step=Slider(0.8, range=0..1), Count=Slider(6, range=0..10))
rhinocode = RhinoCode(x=series, y=number_slider)  # -> out, a, b; inputs x: Double, y: Double
# ---------- rhinocode: C# ----------
// Default C# Script Instance with extended overrides
using System;
using System.Collections;
using System.Collections.Generic;
using System.Drawing;
using System.Threading;

using Rhino;
using Rhino.Geometry;

using Grasshopper;
using Grasshopper.Kernel;
using Grasshopper.Kernel.Data;
using Grasshopper.Kernel.Types;

Random rnd = new Random();
RhinoApp.WriteLine(rnd.Next().ToString());

public class Script_Instance : GH_ScriptInstance
{
  private void RunScript(double x, double y, ref object a, ref object b)
  {
    // Write your logic here
    Print("RunScript");
    a = x + y;
    b = new Sphere(Point3d.Origin, x);
  }
  
  public override void AfterRunScript()
  {
    // Print does not work here
    Print("AfterRunScript");
  }
}
# ---------- end rhinocode ----------
rhinocode_2 = RhinoCode(x=rhinocode.a, y=number_slider)  # -> out, a
# ---------- rhinocode_2: Python ----------
"""Default Python script"""


a = x + y
print(a)
# ---------- end rhinocode_2 ----------
panel = Panel(rhinocode.a)
script = Script(x=rhinocode_2.a, y=number_slider)  # -> out, a; same code as rhinocode_2
panel_2 = Panel(rhinocode_2.a)
panel_3 = Panel(script.a)
