# Grasshopper definition BatchPrinting_Component.gh (Grasshopper 1.0.8)
# plug-ins: RhinoCodePluginGH

cs = CSharpScript(run=Toggle(True))  # -> out, a; inputs run: Boolean
# ---------- cs: C# ----------
// Grasshopper Script Instance
#region Usings
using System;
using System.Collections;
using System.Collections.Generic;
using System.Drawing;
using System.IO;
using System.Linq;

using Rhino;
using Rhino.Display;
using Rhino.FileIO;
using Rhino.Geometry;
using Eto.Forms;

using Grasshopper;
using Grasshopper.Kernel;
using Grasshopper.Kernel.Data;
using Grasshopper.Kernel.Types;
#endregion

public class Script_Instance : GH_ScriptInstance
{
    #region Notes
    /* 
      Members:
        RhinoDoc RhinoDocument
        GH_Document GrasshopperDocument
        IGH_Component Component
        int Iteration

      Methods (Virtual & overridable):
        Print(string text)
        Print(string format, params object[] args)
        Reflect(object obj)
        Reflect(object obj, string method_name)
    */
    #endregion

    private void RunScript(bool run, ref object a)
    {
        if (run)
        {
            // 1 - Getting the path to the files to print
            string path = string.Empty;
            //Rhino.Input.RhinoGet.GetString("Please select the folder where your files live in", false, ref path);

            var dialog = new SelectFolderDialog();
            if (dialog.ShowDialog(null) != DialogResult.Ok)
            {
                Console.WriteLine($"There was an error");
            }

            path = dialog.Directory;
            Console.WriteLine($"My path: {path}");

            // 2 - Filtering the files 
            var filenames = new List<string>();

            var allFiles = Directory.GetFiles(path);
            foreach (string filename in allFiles)
            {
                if (!filename.EndsWith(".3dm"))
                {
                    continue;
                }

                filenames.Add(filename);
            }

            Console.WriteLine($"Files in the directory: {allFiles.Length}");
            Console.WriteLine($"3dm files in the directory: {filenames.Count}");


            // 3 - Opening files and printing
            var export = new List<string>();
            foreach (string file in filenames)
            {
                Rhino.RhinoDoc.ActiveDoc.Modified = false;

                var script = $"_-Open {file}";
                Rhino.RhinoApp.RunScript(script, false);
                var doc = Rhino.RhinoDoc.ActiveDoc;

                var pdf = FilePdf.Create();
                var dpi = 600;
                var pages = doc.Views.GetPageViews();
                foreach(RhinoPageView page in pages)
                {
                    var capture = new ViewCaptureSettings(page, 600);
                    capture.OutputColor = 0;
                    capture.DefaultPrintWidthMillimeters = 0.2;

                    pdf.AddPage(capture);
                }

                pdf.Write(file.Replace(".3dm", ".pdf"));
                export.Add($"{file} printed!!");
            }

            a = export;
        }
    }
}
# ---------- end cs ----------
panel = Panel(cs.a)
