# Grasshopper definition BatchPrinting_Context_Component.ghx (Grasshopper 1.0.8)
# plug-ins: RhinoCodePluginGH

get_file_path = GetFilePath("/fake/file/path", AtLeast=1, AtMost=1, Prompt="Please select the folder where your files live in", TreeAccess=False)
cs = CSharpScript(path=get_file_path)  # -> out; inputs path: String
# ---------- cs: C# ----------
using System;
using Grasshopper.Kernel;

ghenv.Component.AddRuntimeMessage(GH_RuntimeMessageLevel.Remark, "do your things with 'path'");
Console.WriteLine(path ?? string.Empty);
# ---------- end cs ----------
panel = Panel(cs)
context_print = ContextPrint(Output=cs)
